# Grasshopper definition Panel.gh (Grasshopper 1.0.7)

srf = Surface(<surface referenced from the Rhino model>)
divide = DivideDomain²(Domain=srf, UCount=Slider(5, range=0..100), VCount=Slider(23, range=0..100))
subsrf = Isotrim(Surface=srf, Domain=divide)
debrep = DeconstructBrep(Brep=subsrf)  # -> Faces, Edges, Vertices
join = JoinCurves(Curves=debrep.Edges, Preserve=False)
offsets = OffsetOnSrf(Curve=join, Distance=Slider(0.3, range=0..1), Surface=debrep.Faces)
explode = Explode(Curve=offsets, Recursive=True)  # -> Segments, Vertices
merge = Merge(Data1=simplify(graft(explode.Segments)), Data2=simplify(graft(debrep.Edges)))
md_slider = MDSlider(
    SliderMode=0,
    slider_value=Point(0.72562762, 0.6646110721, 0.5),
    x_domain=Domain(0, 1),
    y_domain=Domain(0, 1),
    z_domain=Domain(0, 1))
loft = Loft(Curves=merge, Options={Adjust=False, Closed=False, LoftEnds=0, LoftSimp=0, LoftType=0, Rebuild=10, Refit=0.01})
panel = Panel(loft)
evalsrf = EvaluateSurface(Surface=reparameterize(debrep.Faces), Point=md_slider)  # -> Point, Normal, UDirection, VDirection, Frame
scale = Scale(Geometry=explode.Segments, Center=evalsrf.Point, Factor=Slider(0.5, range=0..1))  # -> Geometry, Transform
multiplication = Multiplication(A=evalsrf.Normal, B=Slider(2, range=0..10))
move = Move(Geometry=scale.Geometry, Motion=multiplication)  # -> Geometry, Transform
merge_2 = Merge(Data1=graft(explode.Segments), Data2=graft(move.Geometry))
loft_2 = Loft(Curves=merge_2, Options={Adjust=False, Closed=False, LoftEnds=0, LoftSimp=0, LoftType=0, Rebuild=10, Refit=0.01})
preview = CustomPreview(
    Geometry=loft_2,
    Material={diffuse=RGB(221, 160, 221), emission=RGB(66, 48, 66), shine=0.5, specular=RGB(255, 255, 255), transparency=0})
