# Grasshopper definition head.gh (Grasshopper 0.9.76)

series = Series(Start=0, Step="0.5", Count="20")
random = Random(Range="0.01 to 0.2", Number="120", Seed=234)
X = UnitX(Factor=series)
ma = MassAddition(Input=random)  # -> Result, PartialResults
pt = ConstructPoint(XCoordinate=X, YCoordinate=0, ZCoordinate=graft(ma.PartialResults))
Y = UnitY(Factor=1)
mesh = Mesh(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)
project = ProjectPoint(Point=pt, Direction=Y, Geometry=mesh)  # -> Point, Index
intcrv = Interpolate(Vertices=project.Point, Degree=3, Periodic=False, KnotStyle=1)  # -> Curve, Length, Domain
ext = ExtendCurve(Curve=intcrv.Curve, Type=2, Start="-2", End="-2")
ext_2 = ExtendCurve(Curve=ext, Type=2, Start="40", End="40")
