# Grasshopper definition isosurface.gh (Grasshopper 0.9.76)
# plug-ins: Millipede

number_slider = Slider(14, range=0..30)
dom = ConstructDomain(DomainStart=0, DomainEnd=100)
number_slider_2 = Slider(30, range=0..100)
range = Range(Domain=Domain(0, 1), Steps=expr("x-1", number_slider))
box = DomainBox(Base=PlaneXY(0, 0, 0), X=dom, Y=dom, Z=dom)
panel = Panel("""1.0
-1.0""")
crossref = CrossReference(ListA=range, ListB=range, ListC=range, CrossMode=1)  # -> ListA, ListB, ListC
pop3d = Populate3D(Region=box, Count=number_slider_2, Seed=Slider(25, range=0..100))
repeat = RepeatData(Data=panel, Length=number_slider_2)
pcharge = PointCharge(Point=pop3d, Charge=repeat, Decay=2)
box_2 = EvaluateBox(Box=box, UParameter=crossref.ListA, VParameter=crossref.ListB, WParameter=crossref.ListC)  # -> Plane, Point, Include
mergef = MergeFields(Fields=pcharge)
evf = EvaluateField(Field=mergef, Point=box_2.Point)  # -> Tensor, Strength
avr = Average(Input=evf.Strength)
panel_2 = Panel(avr)
iso_surface = IsoSurface(
    Box=box,
    Values=evf.Strength,
    XResolution=number_slider,
    YResolution=number_slider,
    ZResolution=number_slider,
    IsoValue=Slider(0.002471, range=0..0.01),
    MergeVertices=Toggle(True))
