# Grasshopper definition lineface.gh (Grasshopper 0.9.76)
# Copyright: serega.home@mail.ru

number_slider = Slider(200, range=0..1000)
# 2D
rectangle = Rectangle(Plane=PlaneXY(0, 0, 0), XSize=Slider(180, range=0..1000), YSize=Slider(200, range=0..1000), Radius=0)  # -> Rectangle, Length
# 3D
box = DomainBox(Base=PlaneXY(0, 0, 0), X=Slider(180, range=0..1000), Y=number_slider, Z=number_slider)
pop3d = Populate3D(Region=box, Count=Slider(50, range=0..100), Seed=Slider(2, range=0..10))
pop2d = Populate2D(Region=rectangle.Rectangle, Count=Slider(50, range=0..100), Seed=Slider(2, range=0..10))
graft = GraftTree(Tree=pop2d, IncludeEmptyLists=True, IncludeNullItems=True)
graft_2 = GraftTree(Tree=pop3d, IncludeEmptyLists=True, IncludeNullItems=True)
ln = Line(StartPoint=pop2d, EndPoint=graft)
ln_2 = Line(StartPoint=pop3d, EndPoint=graft_2)
reb = RebuildCurve(Curve=ln, Count=10, Tangents=False)  # -> reparameterize(Curve)
range = Range(Domain=Domain(0, 1), Steps=10)
reb_2 = RebuildCurve(Curve=ln_2, Count=10, Tangents=False)  # -> reparameterize(Curve)
range_2 = Range(Domain=Domain(0, 1), Steps=10)
shatter = Shatter(Curve=reb, Parameters=range)
shatter_2 = Shatter(Curve=reb_2, Parameters=range_2)
eval = EvaluateCurve(Curve=reparameterize(shatter), Parameter="0.5")  # -> Point, Tangent, Angle
eval_2 = EvaluateCurve(Curve=reparameterize(shatter_2), Parameter="0.5")  # -> Point, Tangent, Angle
image = ImageSampler(
    eval.Point,
    FilePath="C:\Users\Vashevich\Другое\ава\Screenshot_34.png",
    Filter="Colour",
    Interpolate=False,
    Umax=180,
    Umin=0,
    Vmax=200,
    Vmin=0,
    Wrap=1)
image_2 = ImageSampler(
    eval_2.Point,
    FilePath="C:\Users\Vashevich\Другое\ава\Screenshot_34.png",
    Filter="Colour",
    Interpolate=False,
    Umax=180,
    Umin=0,
    Vmax=200,
    Vmin=0,
    Wrap=1)
preview = CustomPreview(Geometry=shatter, Shader=image)
preview_2 = CustomPreview(Geometry=shatter_2, Shader=image_2)
